# Grasshopper definition clip2.gh (Grasshopper 1.0.7)

vector_xyz = VectorXYZ(XComponent=Slider(0, range=0..1), YComponent=0, ZComponent=Slider(9.979, range=0..50))  # -> Vector, Length
number_slider = Slider(1.1, range=0..50)
extrude = Extrude(Base=<curve referenced from the Rhino model>, Direction=vector_xyz.Vector)
scale_nu = ScaleNU(Geometry=extrude, Plane=PlaneXY(0, 0, 0), ScaleX=number_slider, ScaleY=number_slider, ScaleZ=Slider(1, range=0..50))  # -> Geometry, Transform
offset_surface = OffsetSurface(Surface=scale_nu.Geometry, Distance=Slider(2, range=0..50), Retrim=True)
ruled_surface = RuledSurface(CurveA=offset_surface, CurveB=scale_nu.Geometry)
brep = Brep(scale_nu.Geometry)
brep_2 = Brep(ruled_surface)
brep_3 = Brep(offset_surface)
merge = Merge(Data1=brep_3, Data2=brep, Data3=brep_2)
brep_4 = Brep(merge)
