# Grasshopper definition nested wheel.gh (Grasshopper 1.0.7)

point = Point(Point(10.05464402, 0, -0.005733248379))
point_2 = Point(Point(8.991158034, 0, -2.140731707))
point_3 = Point(Point(8.998083059, 0, 2.129129036))
arc_3pt = Arc3Pt(PointA=point_3, PointB=point, PointC=point_2)  # -> Arc, Plane, Radius
circle = Circle(Plane=PlaneXY(0, 0, 0), Radius=Slider(2.697, range=0..100))
offset_curve = OffsetCurve(Curve=arc_3pt.Arc, Distance=Slider(0.8, range=-50..100), Plane=PlaneXY(0, 0, 0), Corners=1)
circle_2 = Circle(Plane=PlaneXY(0, 0, 0), Radius=Slider(2.696, range=0..100))
offset_curve_2 = OffsetCurve(Curve=arc_3pt.Arc, Distance=Slider(0.8, range=-50..100), Plane=PlaneXY(0, 0, 0), Corners=1)
curve = Curve(arc_3pt.Arc)
sweep1 = Sweep1(Rail=circle, Sections=offset_curve, Miter=0)
sweep1_2 = Sweep1(Rail=circle_2, Sections=offset_curve_2, Miter=0)
number_slider = Slider(1.396, range=0..10)
scale_nu = ScaleNU(Geometry=sweep1, Plane=PlaneXY(0, 0, 0), ScaleX=number_slider, ScaleY=number_slider, ScaleZ=Slider(1, range=0..10))  # -> Geometry, Transform
cap_holes = CapHoles(Brep=sweep1_2)
cap_holes_2 = CapHoles(Brep=scale_nu.Geometry)
vector_xyz = VectorXYZ(XComponent=Slider(0, range=0..50), YComponent=Slider(0.623, range=0..1), ZComponent=Slider(0, range=0..50))  # -> Vector, Length
solid_difference = SolidDifference(BrepsA=cap_holes_2, BrepsB=cap_holes)
move = Move(Motion=vector_xyz.Vector)  # -> Geometry, Transform
number_slider_2 = Slider(1.44, range=0..50)
number_slider_3 = Slider(1, range=0..50)
scale_nu_2 = ScaleNU(
    Geometry=solid_difference,
    Plane=PlaneXY(0, 0, 0),
    ScaleX=number_slider_2,
    ScaleY=number_slider_2,
    ScaleZ=number_slider_3)  # -> Geometry, Transform

brep = Brep(scale_nu_2.Geometry)
scale_nu_3 = ScaleNU(Geometry=brep, Plane=PlaneXY(0, 0, 0), ScaleX=number_slider_2, ScaleY=number_slider_2, ScaleZ=number_slider_3)  # -> Geometry, Transform
number_slider_4 = Slider(0.661, range=-10..10)
brep_2 = Brep(scale_nu_3.Geometry)
scale_nu_4 = ScaleNU(
    Geometry=scale_nu.Geometry,
    Plane=PlaneXY(0, 0, 0),
    ScaleX=number_slider_4,
    ScaleY=number_slider_4,
    ScaleZ=number_slider_3)  # -> Geometry, Transform
number_slider_5 = Slider(0.293, range=-10..10)
cap_holes_3 = CapHoles(Brep=scale_nu_4.Geometry)
scale_nu_5 = ScaleNU(Geometry=cap_holes_3, Plane=PlaneXY(0, 0, 0), ScaleX=number_slider_5, ScaleY=number_slider_5, ScaleZ=number_slider_3)  # -> Geometry, Transform
brep_3 = Brep(scale_nu_5.Geometry)
solid_difference_2 = SolidDifference(BrepsA=cap_holes_3, BrepsB=brep_3)
